# Grasshopper definition MJProcGen.gh (Grasshopper 1.0.8)
# plug-ins: MJ_Proc_Gen

panel = Panel("C:\Users\Drew\Desktop\Projects\MJ Proc Gen\rulesets\trees.xml")
panel_2 = Panel("C:\Users\Drew\Desktop\Projects\MJ Proc Gen\rulesets\random.xml")
panel_3 = Panel("C:\Users\Drew\Desktop\Projects\MJ Proc Gen\rulesets\rotref.xml")
panel_4 = Panel("C:\Users\Drew\Desktop\Projects\MJ Proc Gen\rulesets\BrickBuilding.xml")
panel_5 = Panel("C:\Users\Drew\Desktop\Projects\MJ Proc Gen\rulesets\huts.xml")
panel_6 = Panel("C:\Users\Drew\Desktop\Projects\MJ Proc Gen\rulesets\walker.xml")
panel_7 = Panel("C:\Users\Drew\Desktop\Projects\MJ Proc Gen\rulesets\walkerRetrace.xml")

# ---- group: Basic Shapes
pt = Point(<point referenced from the Rhino model>)
object = ModelObject(<model object referenced from the Rhino model>)
object_2 = ModelObject(<model object referenced from the Rhino model>)
pt_2 = Point(<point referenced from the Rhino model>)
pt_3 = Point(<point referenced from the Rhino model>)
object_3 = ModelObject(<model object referenced from the Rhino model>)
pt_4 = Point(<point referenced from the Rhino model>)
object_4 = ModelObject(<model object referenced from the Rhino model>)
pt_5 = Point(<point referenced from the Rhino model>)
object_5 = ModelObject(<model object referenced from the Rhino model>)
pt_6 = Point(<point referenced from the Rhino model>)
object_6 = ModelObject(<model object referenced from the Rhino model>)
sample = Sample(ReferenceName="CYL", ReferencePoint=pt_6, ModelObject=object_6)
sample_2 = Sample(ReferenceName="SPS", ReferencePoint=pt_2, ModelObject=object_3)
sample_3 = Sample(ReferenceName="SPH", ReferencePoint=pt_3, ModelObject=object_4)
sample_4 = Sample(ReferenceName="BOX", ReferencePoint=pt_4, ModelObject=object_2)
sample_5 = Sample(ReferenceName="BXS", ReferencePoint=pt, ModelObject=object)
sample_6 = Sample(ReferenceName="AIR", ReferencePoint=pt_4)
sample_7 = Sample(ReferenceName="BXV", ReferencePoint=pt_5, ModelObject=object_5)
merge = Merge(Data1=sample_6, Data2=sample_4, Data3=sample_5, Data4=sample, Data5=sample_3, Data6=sample_2, Data7=sample_7)

# ---- group: Create Space
number_slider = Slider(20, range=1..100)
number_slider_2 = Slider(20, range=1..100)
number_slider_3 = Slider(20, range=1..100)
panel_8 = Panel("space")
mj_space = MJSpace(Name=panel_8, XSize=number_slider, YSize=number_slider_2, ZSize=number_slider_3, DefaultState="AIR")

# ---- group: Run Parameters
number_slider_4 = Slider(10000, range=0..1000000)
number_slider_5 = Slider(31013, range=-1000000..1000000)
frame_100 = Slider(1, range=1..100)
frame_1000 = Slider(113, range=1..1000)
frame_10000 = Slider(1, range=1..10000)
panel_9 = Panel("BrickBuilding")
refresh = Button()

# ---- group: RuleSet file paths
rulesets = Merge(Data1=panel, Data2=panel_5, Data3=panel_2, Data4=panel_3, Data5=panel_6, Data6=panel_7, Data7=panel_4)

# ---- group: Colored Boxes
pt_7 = Point(<point referenced from the Rhino model>)
object_7 = ModelObject(<model object referenced from the Rhino model>)
pt_8 = Point(<point referenced from the Rhino model>)
object_8 = ModelObject(<model object referenced from the Rhino model>)
pt_9 = Point(<point referenced from the Rhino model>)
pt_10 = Point(<point referenced from the Rhino model>)
object_9 = ModelObject(<model object referenced from the Rhino model>)
pt_11 = Point(<point referenced from the Rhino model>)
object_10 = ModelObject(<model object referenced from the Rhino model>)
object_11 = ModelObject(<model object referenced from the Rhino model>)
pt_12 = Point(<point referenced from the Rhino model>)
object_12 = ModelObject(<model object referenced from the Rhino model>)
sample_8 = Sample(ReferenceName="PRP", ReferencePoint=pt_7, ModelObject=object_7)
sample_9 = Sample(ReferenceName="BLU", ReferencePoint=pt_8, ModelObject=object_8)
sample_10 = Sample(ReferenceName="RED", ReferencePoint=pt_12, ModelObject=object_12)
sample_11 = Sample(ReferenceName="YLW", ReferencePoint=pt_9, ModelObject=object_9)
sample_12 = Sample(ReferenceName="ORG", ReferencePoint=pt_10, ModelObject=object_10)
sample_13 = Sample(ReferenceName="GRN", ReferencePoint=pt_11, ModelObject=object_11)
merge_2 = Merge(Data1=sample_10, Data2=sample_12, Data3=sample_11, Data4=sample_13, Data5=sample_9, Data6=sample_8)

# ---- group: Finished Material
object_13 = ModelObject(<model object referenced from the Rhino model>)
pt_13 = Point(<point referenced from the Rhino model>)
pt_14 = Point(<point referenced from the Rhino model>)
object_14 = ModelObject([<model object referenced from the Rhino model> x2])
pt_15 = Point(<point referenced from the Rhino model>)
object_15 = ModelObject([<model object referenced from the Rhino model> x2])
sample_14 = Sample(ReferenceName="BRK", ReferencePoint=pt_13, ModelObject=object_13)
sample_15 = Sample(ReferenceName="WDX", ReferencePoint=pt_14, ModelObject=object_14)
sample_16 = Sample(ReferenceName="WDY", ReferencePoint=pt_15, ModelObject=object_15)
merge_3 = Merge(Data1=sample_14, Data2=sample_15, Data3=sample_16)

# ---- group: Initiate Main
refresh_2 = Button()
init_mj = InitiateMJ(Spaces=mj_space, Rulesets=rulesets, EnableDebug=Toggle(True), Refresh=refresh_2)  # -> MJ_Main, DebugLog; disabled

# ----
panel_10 = Panel("walkerRetrace")

# ---- group: Model Frame Parameters
model_samples = Merge(Data1=merge_3, Data2=merge, Data3=merge_2)  # -> flatten(Result)
number_slider_6 = Slider(10, range=0..10)

# ----
run_mj = RunMJ(
    MJ_Main=init_mj.MJ_Main,
    Space=panel_8,
    Ruleset=panel_9,
    MaximumOperations=number_slider_4,
    RandomSeed=number_slider_5,
    Refresh=refresh)  # -> MJ_Main, DebugLog

# ---- group: Output MJ
subtraction = Subtraction(A=frame_1000, _1=1)
output_mj = OutputMJ(MJ_Main=run_mj.MJ_Main, Space=panel_8, Frame=subtraction)  # -> MJ_Main, OperationCount, FrameCount, Frame, AllFrames, RuleRun
rule_run = Panel(output_mj.RuleRun)
frame_count = Panel(output_mj.FrameCount)
op_count = Panel(output_mj.OperationCount)
panel_11 = Panel(output_mj.Frame)

# ---- group: Model Frame
model_frame = ModelFrame(
    Frame=output_mj.Frame,
    XSize=number_slider,
    YSize=number_slider_2,
    ZSize=number_slider_3,
    Spacing=number_slider_6,
    Samples=model_samples)
object_16 = ModelObject(Object=model_frame)  # -> Object, Geometry, Name, Layer, Visibility, Display, Drafting, Render
action = Action({"Purge", "Pull", "Push", "Bake"}, selected="Push")
material = CreateMaterial(
    Diffuse=ColourSwatch(SwatchColor=RGB(158, 44, 44)),
    Specular=RGB(255, 255, 255),
    Emission=RGB(0, 0, 0),
    Transparency=0,
    Shine=0)
preview = CustomPreview(Geometry=object_16.Geometry, Material=material)  # disabled
cache = ContentCache(Content=object_16.Object, Action=action, UseTasks=False)
panel_12 = Panel(cache)
lng = ListLength(List=cache)
panel_13 = Panel(lng)

# ----
panel_14 = Panel(run_mj.DebugLog)
cache_2 = ContentCache(Content=cache, Action=Button())
